# Grasshopper definition 2d_truss_decomposer.gh (Grasshopper 1.0.7)
# plug-ins: BH.UI.Grasshopper

name = Text()

name_2 = Text(name)
text_split = TextSplit(Text=name_2, Separators=" ")
text_join = TextJoin(Text=text_split, Join="_")
concatenate = Concatenate(FragmentA="*", FragmentB=text_join, FragmentC="_TRUSS*")

sectiondefinitions = Data()

text_split_2 = TextSplit(Text=concatenate, Separators="*")
list_item = ListItem(List=text_split_2, Index=0, Wrap=True)  # -> Item, Item1
name_3 = Text(list_item.Item1)

# ---- group: Find Truss Sections and sort into Top, Bottom, Diagonal
sectiondefinitions_2 = Data(sectiondefinitions)
list_item_2 = ListItem(List=sectiondefinitions_2, Index=Slider(4, range=0..10), Wrap=True)
match_text = MatchText(Text=list_item_2, Pattern=concatenate, Case=True)  # -> simplify(Match)
dispatch = Dispatch(List=sectiondefinitions_2, DispatchPattern=match_text)  # -> ListA, ListB
clean_tree = CleanTree(RemoveNulls=True, RemoveInvalid=True, RemoveEmpty=True, Tree=dispatch.ListA)
panel = Panel("""*Top*
*Bottom*
*Diagonal*""")
list_item_3 = ListItem(List=clean_tree, Index=Slider(3, range=0..10), Wrap=True)  # -> flatten(Item)
tree_statistics = TreeStatistics(Tree=clean_tree)  # -> Paths, Length, Count
match_text_2 = MatchText(Text=list_item_3, Pattern=graft(panel), Case=False)
dispatch_2 = Dispatch(List=tree_statistics.Paths, DispatchPattern=match_text_2)  # -> flatten(ListA), ListB
tree_branch = TreeBranch(Tree=clean_tree, Path=dispatch_2.ListA, MaintainPaths=False)
data = Data(tree_branch)

# ----
bhom_truss = BHoMObject()
cluster = Cluster(beam_data=data)  # -> flatten(steelsection_2)
list_item_4 = ListItem(List=cluster, Index=0, Wrap=True)  # -> Item, Item1, Item2

# ---- group: Adjust TOS Level of Bottom Steel Chord
bhom_truss_2 = BHoMObject(
    bhom_truss,
    ObjectType="{ \"_t\" : \"System.Type\", \"Name\" : \"System.Object, mscorlib, Version=4.0.0.0, Culture=neutral, PublicKeyToken=b77a5c561934e089\", \"_bhomVersion\" : \"8.1\" }",
    m_ForcePreview=False,
    m_MaxItemsPreview=10000)
explode = Explode(Object=bhom_truss_2, Component="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")  # -> simplify(TopChord), simplify(BottomChord), simplify(Bracing), BHoM_Guid, Name, Fragments, Tags, CustomData
bottom_chord = BHoMObject(
    list_item_4.Item1,
    ObjectType="{ \"_t\" : \"System.Type\", \"Name\" : \"System.Object, mscorlib, Version=4.0.0.0, Culture=neutral, PublicKeyToken=b77a5c561934e089\", \"_bhomVersion\" : \"8.1\" }",
    m_ForcePreview=False,
    m_MaxItemsPreview=10000)
getproperty = GetProperty(Obj=bottom_chord, PropName="SectionProfile", Component="{ .GetProperty")
getproperty_2 = GetProperty(Obj=getproperty, PropName="Height", Component="{ .GetProperty")
snaptoelements = SnapToElements(
    Element1D=explode.Bracing,
    RefElements=flatten(explode.BottomChord),
    MaxDistance=getproperty_2,
    Tolerance=1e-06,
    Component="{ .SnapToElements")

# ----
angle = Slider(90, range=0..90)
radians = Radians(Degrees=angle)

# ---- group: Filter Vertical and Diagonal Bracings
vertical_bracings_filtering_pattern = Panel("""True
False""")
angle_2 = Slider(0, range=0..90)
cluster_2 = Cluster_2(bracings=snaptoelements, filtering_pattern=vertical_bracings_filtering_pattern)  # -> vertical_bracings_2, diagonal_bracings_2
radians_2 = Radians(Degrees=angle_2)
bar = Bar(Line=cluster_2.vertical_bracings_2, SectionProperty=bottom_chord, OrientationAngle=radians, Component="{ .Bar")

# ----
bar_2 = Bar(Line=cluster_2.diagonal_bracings_2, SectionProperty=bottom_chord, OrientationAngle=radians_2, Component="{ .Bar")
merge = Merge(Data1=bar, Data2=bar_2)

# ---- group: Assign Section Properties to Truss Frame Elements
setproperty = SetProperty(Obj=explode.TopChord, PropName="SectionProperty", Value=list_item_4.Item, Component="{ .SetPropertyValue")
setproperty_2 = SetProperty(Obj=explode.BottomChord, PropName="SectionProperty", Value=list_item_4.Item1, Component="{ .SetPropertyValue")
setproperty_3 = SetProperty(Obj=merge, PropName="SectionProperty", Value=list_item_4.Item2, Component="{ .SetPropertyValue")
name_4 = Text(name_3)
truss = Truss(
    TopChord=setproperty,
    BottomChord=setproperty_2,
    Bracing=setproperty_3,
    Name=name_4,
    Component="BH.oM.Structure.Trusses.Truss")  # -> simplify(T)
merge_2 = Merge(Data1=setproperty, Data2=setproperty_2, Data3=setproperty_3)

# ----
line_elements = Line(merge_2)
truss_2 = BHoMObject(
    truss,
    ObjectType="{ \"_t\" : \"System.Type\", \"Name\" : \"System.Object, mscorlib, Version=4.0.0.0, Culture=neutral, PublicKeyToken=b77a5c561934e089\", \"_bhomVersion\" : \"8.1\" }",
    m_ForcePreview=False,
    m_MaxItemsPreview=10000)
truss_3 = BHoMObject(truss_2)
line_elements_2 = Line(line_elements)

# ==== cluster Cluster
beam_data = ClusterInput()

# ---- group: 1. Extract Section Names from Beams Data
beam_data_2 = Data(beam_data)
list_item = ListItem(List=beam_data_2, Index="6", Wrap=True)
panel = Panel(list_item)

# ---- group: 2. Extract Section Names from BHOM Library
library = Library(LibraryName="UB", Component="{ .Library")
library_2 = Library(LibraryName="UC", Component="{ .Library")
merge = Merge(Data1=library, Data2=library_2)
getproperty = GetProperty(Obj=merge, PropName="Name", Component="{ .GetProperty")

# ---- group: 3. Extract BHOM Sections based on Names
member_index = MemberIndex(Set=getproperty, Member=list_item)  # -> Index, Count
list_item_2 = ListItem(List=merge, Index=member_index.Index, Wrap=True)  # -> simplify(Item)
steelsection = BHoMObject(
    list_item_2,
    ObjectType="{ \"_t\" : \"System.Type\", \"Name\" : \"System.Object, mscorlib, Version=4.0.0.0, Culture=neutral, PublicKeyToken=b77a5c561934e089\", \"_bhomVersion\" : \"8.1\" }",
    m_ForcePreview=False,
    m_MaxItemsPreview=10000)

# ----
steelsection_2 = ClusterOutput(steelsection)

# ==== cluster Cluster_2
bracings = ClusterInput()
bracings_2 = Line(bracings)
unit_z = UnitZ(Factor=1)
end_points = EndPoints(Curve=bracings_2)  # -> Start, End
vector = Vector(bracings_2)
dot_product = DotProduct(VectorA=vector, VectorB=unit_z, Unitize=True)
vector_display = VectorDisplay(Anchor=end_points.Start, Vector=vector)
absolute = Absolute(Value=dot_product)
equality_within_tolerance = EqualityWithinTolerance(FirstNumber=absolute, SecondNumber="1", Tolerance=0.001)  # -> Equality, Inequality
dispatch = Dispatch(List=bracings_2, DispatchPattern=equality_within_tolerance.Equality)  # -> ListA, ListB
filtering_pattern = ClusterInput()
filtering_pattern_2 = Data(filtering_pattern)
sift_pattern = SiftPattern(List=dispatch.ListA, SiftPattern=filtering_pattern_2)  # -> Output0, Output1
clean_tree = CleanTree(RemoveNulls=True, RemoveInvalid=True, RemoveEmpty=False, Tree=sift_pattern.Output0)
vertical_bracings = Line(clean_tree)
diagonal_bracings = Line(dispatch.ListB)
bar = Bar(Line=vertical_bracings, OrientationAngle=0, Component="{ .Bar")
vertical_bracings_2 = ClusterOutput(vertical_bracings)
diagonal_bracings_2 = ClusterOutput(diagonal_bracings)
