# Grasshopper definition _objects_colorer.gh (Grasshopper 1.0.7)

objects_tree = Data()
colors_list = Data()
objects_tree_2 = Data(simplify(objects_tree))
colors_list_2 = Data(colors_list)
colors_tree = Data(simplify(graft(colors_list_2)))
geometry = Geometry(objects_tree_2)
custom_preview = CustomPreview(Geometry=geometry, Material=colors_tree)
