# Grasshopper definition access_sql_query_snippet.gh (Grasshopper 1.0.7)

# Access SQL Query
connection_string = Panel("Provider=Microsoft.ACE.OLEDB.12.0;Data Source=c:\Users\galbieri\Desktop\WORK\GST Sports Boulevard\2025-07-07 M72 - BMU Left Top Corner\accessFiles\gst_hyperflex.accdb;")
sql_query = Panel("SELECT * FROM [Element Forces - Beams]")
c_script = CSharpScript(connString=connection_string, query=sql_query, trigger=Toggle(False))  # -> data; inputs connString: String, query: String, trigger: Boolean
# ---------- c_script: C# usings ----------
using System.Data.OleDb;
# ---------- c_script: C# ----------
    if (!trigger) return;

    // Update the path to your Access database file
    List<string> output = new List<string>();

    try
    {
      using (OleDbConnection connection = new OleDbConnection(connString))
      {
        connection.Open();
        OleDbCommand cmd = new OleDbCommand(query, connection);
        OleDbDataReader reader = cmd.ExecuteReader();

        while (reader.Read())
        {
          var row = "";
          for (int i = 0; i < reader.FieldCount; i++)
            row += reader.GetValue(i).ToString() + (i < reader.FieldCount - 1 ? ", " : "");
          output.Add(row);
        }
      }
    }
    catch (Exception ex)
    {
      Console.WriteLine("Error: " + ex.Message);
    }

    data = output;
    return;
# ---------- end c_script ----------
# NEVER USE PANELS TO DISPLAY
# THE OUTPUT DATA!!
# IT WILL TAKE FOREVER!
# USE ONLY THE DATA-VIEWER!!
data = Data(c_script)
# EVEN WITH MILLIONS OF PIECES OF DATA IN IT,
# THIS SCRIPT CAN BE SAVED IN NO TIME.
# NO FREEZING, NO CRASHING, NO PAIN....
# IT DOES THE JOB! AND IT DOES IT FAST!
panel = Panel(",")
text_split = TextSplit(Text=data, Separators=panel)  # -> simplify(Result)
flip_matrix = FlipMatrix(Data=text_split)
explode_tree = ExplodeTree(Data=flip_matrix)  # -> Branch0, Branch1, Branch2, Branch3, Branch4, Branch5, Branch6, Branch7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
