# Grasshopper definition agn_conn_forces_formatter_for_excel.gh (Grasshopper 1.0.7)
# plug-ins: BH.UI.Grasshopper

bhom_parameters = Panel("""ObjectId
LoadCombo
NodeId
AxialForce
ShearMajor
ShearMinor
Torsion
MomentMajor
MomentMinor
Tie""")
fea_model_filepath = Data()
agnostic_cfs = Data()
data = Data(simplify(graft(bhom_parameters)))
agnostic_cfs_2 = Data(flatten(agnostic_cfs))
fea_model_filepath_2 = Data(fea_model_filepath)
explode_tree = ExplodeTree(Data=data)  # -> Branch0, Branch1, Branch2, Branch3, Branch4, Branch5, Branch6, Branch7, Branch8, Branch9
vb_script = VBScript(fullFilePath=fea_model_filepath_2)  # -> feaModelName
# ---------- vb_script: VB ----------
    Dim splitFilePath As String() = CStr(fullFilePath).Split("\")
    Dim fileName As String = splitFilePath(splitFilePath.Length - 1).Split(".")(0)

    feaModelName = fileName
# ---------- end vb_script ----------
list_length = ListLength(List=agnostic_cfs_2)
getproperty = GetProperty(Obj=agnostic_cfs_2, PropName=explode_tree.Branch0, Component="{ .GetProperty")
getproperty_2 = GetProperty(Obj=agnostic_cfs_2, PropName=explode_tree.Branch1, Component="{ .GetProperty")
getproperty_3 = GetProperty(Obj=agnostic_cfs_2, PropName=explode_tree.Branch2, Component="{ .GetProperty")
getproperty_4 = GetProperty(Obj=agnostic_cfs_2, PropName=explode_tree.Branch3, Component="{ .GetProperty")
getproperty_5 = GetProperty(Obj=agnostic_cfs_2, PropName=explode_tree.Branch4, Component="{ .GetProperty")
getproperty_6 = GetProperty(Obj=agnostic_cfs_2, PropName=explode_tree.Branch5, Component="{ .GetProperty")
getproperty_7 = GetProperty(Obj=agnostic_cfs_2, PropName=explode_tree.Branch6, Component="{ .GetProperty")
getproperty_8 = GetProperty(Obj=agnostic_cfs_2, PropName=explode_tree.Branch7, Component="{ .GetProperty")
getproperty_9 = GetProperty(Obj=agnostic_cfs_2, PropName=explode_tree.Branch8, Component="{ .GetProperty")
getproperty_10 = GetProperty(Obj=agnostic_cfs_2, PropName=explode_tree.Branch9, Component="{ .GetProperty")
duplicate_data = DuplicateData(Data=vb_script, Number=list_length, Order=True)
entwine = Entwine(
    Branch00=getproperty,
    Branch01=getproperty_2,
    Branch02=getproperty_3,
    Branch03=getproperty_4,
    Branch04=getproperty_5,
    Branch05=getproperty_6,
    Branch06=getproperty_7,
    Branch07=getproperty_8,
    Branch08=getproperty_9,
    Branch09=getproperty_10,
    Branch010=duplicate_data,
    FlattenInputs=True)
excel_data = Data(entwine)
excel_data_2 = Data(excel_data)
