# Grasshopper definition agnostic_to_standard_forces_adapter.gh (Grasshopper 1.0.7)
# plug-ins: BH.UI.Grasshopper

bhom_parameters = Panel("""ObjectId
LoadCombo
Position
Node
NodeId
Release
FX
FY
FZ
MX
MY
MZ
Tie""")
agnostic_cfs = Data()
data = Data(simplify(graft(bhom_parameters)))
agnostic_cfs_2 = Data(flatten(agnostic_cfs))
explode_tree = ExplodeTree(Data=data)  # -> Branch0, Branch1, Branch2, Branch3, Branch4, Branch5, Branch6, Branch7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
getproperty = GetProperty(Obj=agnostic_cfs_2, PropName=explode_tree.Branch0, Component="{ .GetProperty")
getproperty_2 = GetProperty(Obj=agnostic_cfs_2, PropName=explode_tree.Branch1, Component="{ .GetProperty")
getproperty_3 = GetProperty(Obj=agnostic_cfs_2, PropName=explode_tree.Branch2, Component="{ .GetProperty")
getproperty_4 = GetProperty(Obj=agnostic_cfs_2, PropName=explode_tree.Branch3, Component="{ .GetProperty")
getproperty_5 = GetProperty(Obj=agnostic_cfs_2, PropName=explode_tree.Branch4, Component="{ .GetProperty")
getproperty_6 = GetProperty(Obj=agnostic_cfs_2, PropName=explode_tree.Branch5, Component="{ .GetProperty")
getproperty_7 = GetProperty(Obj=agnostic_cfs_2, PropName=explode_tree.Branch6, Component="{ .GetProperty")
getproperty_8 = GetProperty(Obj=agnostic_cfs_2, PropName=explode_tree.Branch7, Component="{ .GetProperty")
getproperty_9 = GetProperty(Obj=agnostic_cfs_2, PropName=explode_tree.Branch11, Component="{ .GetProperty")
getproperty_10 = GetProperty(Obj=agnostic_cfs_2, PropName=explode_tree.Branch12, Component="{ .GetProperty")
getproperty_11 = GetProperty(Obj=agnostic_cfs_2, PropName=explode_tree.Branch8, Component="{ .GetProperty")
getproperty_12 = GetProperty(Obj=agnostic_cfs_2, PropName=explode_tree.Branch9, Component="{ .GetProperty")
getproperty_13 = GetProperty(Obj=agnostic_cfs_2, PropName=explode_tree.Branch10, Component="{ .GetProperty")
ties = Data(getproperty_10)
custom_connection_force = CreateCustom(
    ObjectId=getproperty,
    LoadCombo=getproperty_2,
    Position=getproperty_3,
    Node=getproperty_4,
    NodeId=getproperty_5,
    Release=getproperty_6,
    AxialForce=getproperty_7,
    ShearMajor=getproperty_8,
    ShearMinor=getproperty_11,
    Torsion=getproperty_12,
    MomentMajor=getproperty_13,
    MomentMinor=getproperty_9,
    Component="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")
null_item = NullItem(Item=ties)  # -> NullFlags, InvalidFlags, Description
true = Boolean(True)
member_index = MemberIndex(Set=null_item.NullFlags, Member=true)  # -> Index, Count
list_length = ListLength(List=ties)
equality = Equality(FirstNumber=list_length, SecondNumber=member_index.Count)  # -> Equality, Inequality
stream_gate = StreamGate(Stream=custom_connection_force, Gate=equality.Equality)  # -> Target0, Target1
ties_2 = Data(ties)
setproperty = SetProperty(Obj=stream_gate.Target0, PropName="Tie", Value=ties_2, Component="{ .SetPropertyValue")
merge = Merge(Data1=setproperty, Data2=stream_gate.Target1)
standardised_cfs = Data(merge)
standardised_cfs_2 = Data(standardised_cfs)
