# Grasshopper definition arched_trusses_chords_factory.gh (Grasshopper 1.0.7)

bottom_point = Point()
top_point = Point()
btm_tangent_vector_angle = Data()
depth_end_01_m = Data()
end_01_depth_vector_angle = Data()
depth_end_02_m = Data()
end_02_depth_vector_angle = Data()
top_tangent_vector_angle = Data()
top_point_2 = Point(top_point)
bottom_point_2 = Point(bottom_point)
btm_tangent_vector_angle_2 = Data(btm_tangent_vector_angle)
depth_end_01_m_2 = Data(depth_end_01_m)
end_01_depth_vector_angle_2 = Data(end_01_depth_vector_angle)
depth_end_02_m_2 = Data(depth_end_02_m)
end_02_depth_vector_angle_2 = Data(end_02_depth_vector_angle)
top_tangent_vector_angle_2 = Data(top_tangent_vector_angle)
radians = Radians(Degrees=expr("x-90", end_02_depth_vector_angle_2))
radians_2 = Radians(Degrees=expr("x-90", top_tangent_vector_angle_2))
radians_3 = Radians(Degrees=expr("x-90", btm_tangent_vector_angle_2))
radians_4 = Radians(Degrees=expr("x-90", end_01_depth_vector_angle_2))
unit_z = UnitZ(Factor=1)
xz_plane = XZPlane(Origin=Point(0, 0, 0))
rotate = Rotate(Vector=unit_z, Axis=xz_plane, Angle=radians_2)
rotate_2 = Rotate(Vector=unit_z, Axis=xz_plane, Angle=radians_3)
rotate_3 = Rotate(Vector=unit_z, Axis=xz_plane, Angle=radians_4)
rotate_4 = Rotate(Vector=unit_z, Axis=xz_plane, Angle=radians)
amplitude = Amplitude(Vector=rotate_3, Amplitude=depth_end_01_m_2)
amplitude_2 = Amplitude(Vector=rotate_4, Amplitude=depth_end_02_m_2)
arc_sed = ArcSED(Start=bottom_point_2, End=top_point_2, Direction=rotate)  # -> Arc, Plane, Radius
end_points = EndPoints(Curve=arc_sed.Arc)  # -> Start, End
move = Move(Geometry=end_points.End, Motion=amplitude_2)  # -> Geometry, Transform
move_2 = Move(Geometry=end_points.Start, Motion=amplitude)  # -> Geometry, Transform
arc_sed_2 = ArcSED(Start=move_2.Geometry, End=move.Geometry, Direction=rotate_2)  # -> Arc, Plane, Radius
btm_chord = Data(arc_sed_2.Arc)
top_chord = Data(arc_sed.Arc)
top_chord_2 = Data(top_chord)
btm_chord_2 = Data(btm_chord)
