# Grasshopper definition bar_feaids_retriever.gh (Grasshopper 1.0.7)
# plug-ins: BH.UI.Grasshopper

id_pattern = Data()
bhom_bars = BHoMObject()
id_pattern_2 = Data(id_pattern)
bhom_bars_2 = BHoMObject(
    bhom_bars,
    ObjectType="{ \"_t\" : \"System.Type\", \"Name\" : \"System.Object, mscorlib, Version=4.0.0.0, Culture=neutral, PublicKeyToken=b77a5c561934e089\", \"_bhomVersion\" : \"8.1\" }",
    m_ForcePreview=False,
    m_MaxItemsPreview=10000)
getproperty = GetProperty(Obj=bhom_bars_2, PropName="Fragments", Component="{ .GetProperty")
id_pattern_3 = Data(id_pattern_2)
match_text = MatchText(Text=getproperty, Pattern=id_pattern_3, Case=True)
getproperty_2 = GetProperty(Obj=getproperty, PropName="Id", Component="{ .GetProperty")
cull_pattern = CullPattern(List=getproperty_2, CullPattern=match_text)
fea_ids = Data(simplify(cull_pattern))
fea_ids_2 = Data(fea_ids)
