# Grasshopper definition bar_local_axes_display.gh (Grasshopper 1.0.7)
# plug-ins: BH.UI.Grasshopper

bhom_bars = BHoMObject()
bhom_bars_2 = BHoMObject(
    bhom_bars,
    ObjectType="{ \"_t\" : \"System.Type\", \"Name\" : \"System.Object, mscorlib, Version=4.0.0.0, Culture=neutral, PublicKeyToken=b77a5c561934e089\", \"_bhomVersion\" : \"8.1\" }",
    m_ForcePreview=False,
    m_MaxItemsPreview=10000)
curve_frame = CurveFrame(Curve=bhom_bars_2, Parameter="0.5")
deconstruct_plane = DeconstructPlane(Plane=curve_frame)  # -> Origin, XAxis, YAxis, ZAxis
vector = Vector(deconstruct_plane.XAxis)
vector_2 = Vector(deconstruct_plane.YAxis)
vector_3 = Vector(deconstruct_plane.ZAxis)
entwine = Entwine(
    Branch00=ColourSwatch(SwatchColor=RGB(255, 0, 0)),
    Branch01=ColourSwatch(SwatchColor=RGB(110, 255, 0)),
    Branch02=ColourSwatch(SwatchColor=RGB(0, 47, 255)),
    FlattenInputs=True)  # -> simplify(Result)
entwine_2 = Entwine(Branch00=vector, Branch01=vector_2, Branch02=vector_3, FlattenInputs=True)  # -> simplify(Result)
bhom_bars_3 = BHoMObject(
    bhom_bars_2,
    ObjectType="{ \"_t\" : \"System.Type\", \"Name\" : \"System.Object, mscorlib, Version=4.0.0.0, Culture=neutral, PublicKeyToken=b77a5c561934e089\", \"_bhomVersion\" : \"8.1\" }",
    m_ForcePreview=False,
    m_MaxItemsPreview=10000)
custom_preview = CustomPreview(Geometry=bhom_bars_3, Material=ColourSwatch(SwatchColor=RGB(117, 109, 109)))
vector_display_ex = VectorDisplayEx(Point=deconstruct_plane.Origin, Vector=entwine_2, Colour=entwine, Width=Slider(3, range=0..10))
