# Grasshopper definition beams_snapper.gh (Grasshopper 1.0.7)
# plug-ins: BH.UI.Grasshopper

max_dist_snaptoroofsurface_m = Data()
max_dist_snaptoelements_m = Data()
max_dist_snaptoheigths_m = Data()
max_dist_snaptopoints_m = Data()
max_dist_snaptogrids_m = Data()
floor_heights_m = Data()
bhom_elements = Data()
roof_surfaces = Surface()
grids = Data()

# ---- group: INPUTS
max_dist_snaptoroofsurface_m_2 = Data(max_dist_snaptoroofsurface_m)
max_dist_snaptoelements_m_2 = Data(max_dist_snaptoelements_m)
max_dist_snaptoheigths_m_2 = Data(max_dist_snaptoheigths_m)
max_dist_snaptopoints_m_2 = Data(max_dist_snaptopoints_m)
max_dist_snaptogrids_m_2 = Data(max_dist_snaptogrids_m)
floor_heights_m_2 = Data(floor_heights_m)
bhom_elements_2 = Data(bhom_elements)
roof_surfaces_2 = Surface(roof_surfaces)
grids_2 = Data(grids)

# ---- group: SNAP TO FLOOR HEIGHTS
max_dist_snaptoheigths_m_3 = Data(max_dist_snaptoheigths_m_2)
floor_heights_m_3 = Data(floor_heights_m_2)
bhom_elements_3 = Data(bhom_elements_2)
snaptoheights = SnapToHeights(
    Element1D=bhom_elements_3,
    RefHeights=floor_heights_m_3,
    MaxDistance=max_dist_snaptoheigths_m_3,
    Component="{ .SnapToHeights")

# ---- group: PROJECT ONTO ROOF SURFACE
bhom_elements_4 = Data(snaptoheights)
curve_middle = CurveMiddle(Curve=bhom_elements_4)
unit_z = UnitZ(Factor=1)
roof_surfaces_3 = Surface(roof_surfaces_2)
project_point = ProjectPoint(Point=curve_middle, Direction=unit_z, Geometry=roof_surfaces_3)  # -> Point, Index
vector_2pt = Vector2Pt(PointA=curve_middle, PointB=project_point.Point, Unitize=False)  # -> Vector, Length
smaller_than = SmallerThan(FirstNumber=vector_2pt.Length, SecondNumber="0.8")  # -> SmallerThan, OrEqualTo
sift_pattern = SiftPattern(List=vector_2pt.Vector, SiftPattern=smaller_than.OrEqualTo)  # -> Output0, Output1
vectors = Data(sift_pattern.Output1)
bhom_elements_5 = Data(bhom_elements_4)
translationmatrix = TranslationMatrix(Translation=vectors, Component="{ .TranslationMatrix")
sift_pattern_2 = SiftPattern(List=bhom_elements_5, SiftPattern=smaller_than.OrEqualTo)  # -> Output0, Output1
itransform = ITransform(Element1D=sift_pattern_2.Output1, Transform=translationmatrix, Tolerance=1e-06, Component="{ .ITransform")
combine_data = CombineData(Input0=sift_pattern_2.Output0, Input1=itransform)  # -> Result, Index

# ---- group: SNAP TO ROOF SURFACE
max_dist_snaptoroofsurface_m_3 = Data(max_dist_snaptoroofsurface_m_2)
roof_surfaces_4 = Surface(roof_surfaces_2)
snaptoelements = SnapToElements(
    Element1D=combine_data.Result,
    RefElements=roof_surfaces_4,
    MaxDistance=max_dist_snaptoroofsurface_m_3,
    Tolerance=1e-06,
    Component="{ .SnapToElements")

# ---- group: EXTEND TO EACHOTHER
max_dist_snaptoelements_m_3 = Data(max_dist_snaptoelements_m_2)
extendtoeachother = ExtendToEachOther(
    Elements1D=snaptoelements,
    MaxDistance=max_dist_snaptoelements_m_3,
    MinAngle="100",
    Tolerance=1e-06,
    Component="{ .ExtendToEachOther")

# ---- group: SNAP PLANES TO GRIDS
max_dist_snaptogrids_m_3 = Data(max_dist_snaptogrids_m_2)
grids_3 = Data(grids_2)
snapplanetogrids = SnapPlaneToGrids(
    Element1D=extendtoeachother,
    Grids=grids_3,
    MaxDistance=max_dist_snaptogrids_m_3,
    MaxAngle="100",
    Tolerance=1e-06,
    Component="{ .SnapPlaneToGrids")

# ---- group: SNAP ENDS TO GRIDS
max_dist_snaptogrids_m_4 = Data(max_dist_snaptogrids_m_2)
grids_4 = Data(grids_2)
snapendstogrids = SnapEndsToGrids(
    Element1D=snapplanetogrids,
    Grids=grids_4,
    MaxDistance=max_dist_snaptogrids_m_4,
    MinAngle="100",
    Tolerance=1e-06,
    Component="{ .SnapEndsToGrids")

# ---- group: SNAP TO GRID INTERSECTIONS
max_dist_snaptogrids_m_5 = Data(max_dist_snaptogrids_m_2)
grids_5 = Data(grids_2)
snaptogridintersections = SnapToGridIntersections(
    Elements1D=snapendstogrids,
    Grids=grids_5,
    MaxDistance=max_dist_snaptogrids_m_5,
    Tolerance=1e-06,
    Component="{ .SnapToGridIntersections")

# ---- group: SNAP COINCIDENT NODES
max_dist_snaptopoints_m_3 = Data(max_dist_snaptopoints_m_2)
snapcoincidentnodes = SnapCoincidentNodes(Elements=snaptogridintersections, Tolerance=max_dist_snaptopoints_m_3, Component="{ .SnapCoincidentNodes")

# ---- group: OUTPUTS
snapped_bhom_elements = Data(snapcoincidentnodes)

# ----
snapped_bhom_elements_2 = Data(snapped_bhom_elements)
