# Grasshopper definition braces_snapper.gh (Grasshopper 1.0.7)
# plug-ins: BH.UI.Grasshopper

max_dist_snaptoheigths_m = Data()
max_dist_snaptopoints_m = Data()
max_dist_snaptogrids_m = Data()
floor_heights_m = Data()
bhom_elements = Data()
roof_surfaces = Surface()
grids = Data()

# ---- group: INPUTS
max_dist_snaptoheigths_m_2 = Data(max_dist_snaptoheigths_m)
max_dist_snaptopoints_m_2 = Data(max_dist_snaptopoints_m)
max_dist_snaptogrids_m_2 = Data(max_dist_snaptogrids_m)
floor_heights_m_2 = Data(floor_heights_m)
bhom_elements_2 = Data(bhom_elements)
roof_surfaces_2 = Surface(roof_surfaces)
grids_2 = Data(grids)

# ---- group: 1. SNAP END POINTS TO HEIGHTS
end_points = EndPoints(Curve=bhom_elements_2)  # -> Start, End
max_dist_snap_heigths_m = Data(max_dist_snaptoheigths_m_2)
merge = Merge(Data1=end_points.Start, Data2=end_points.End)
floor_heights = Data(floor_heights_m_2)
snaptoheights = SnapToHeights(Element0D=merge, RefHeights=floor_heights, MaxDistance=max_dist_snap_heigths_m, Component="{ .SnapToHeights")

# ---- group: 2. SNAP END POINTS TO ROOF SURFACE
max_dist_snap_points_m = Data(max_dist_snaptopoints_m_2)
bhom_nodes = Data(snaptoheights)
roof_surfaces_3 = Surface(roof_surfaces_2)
snaptoelements = SnapToElements(
    Element0D=bhom_nodes,
    RefElements=roof_surfaces_3,
    MaxDistance=max_dist_snap_points_m,
    Tolerance=1e-06,
    Component="{ .SnapToElements")
bhom_nodes_2 = Data(snaptoelements)

# ---- group: 3. SNAPE ELEMENTS TO GRIDS
max_dist_snaptogrids_m_3 = Data(max_dist_snaptogrids_m_2)
bhom_elements_3 = Data(bhom_elements_2)
grids_3 = Data(grids_2)
snapplanetogrids = SnapPlaneToGrids(
    Element1D=bhom_elements_3,
    Grids=grids_3,
    MaxDistance=max_dist_snaptogrids_m_3,
    MaxAngle="100",
    Tolerance=1e-06,
    Component="{ .SnapPlaneToGrids")

# ---- group: 4. SNAP ELEMENTS TO END POINTS
max_dist_snap_points_m_2 = Data(max_dist_snaptopoints_m_2)
bhom_elements_4 = Data(snapplanetogrids)
bhom_nodes_3 = Data(bhom_nodes_2)
snaptoelements_2 = SnapToElements(
    Element1D=bhom_elements_4,
    RefElements=bhom_nodes_3,
    MaxDistance=max_dist_snap_points_m_2,
    Tolerance=1e-06,
    Component="{ .SnapToElements")

# ---- group: 5. SNAP ENDS TO GRIDS
max_dist_snaptogrids_m_4 = Data(max_dist_snaptogrids_m_2)
bhom_elements_5 = Data(snaptoelements_2)
grids_4 = Data(grids_2)
snapendstogrids = SnapEndsToGrids(
    Element1D=bhom_elements_5,
    Grids=grids_4,
    MaxDistance=max_dist_snaptogrids_m_4,
    MinAngle="0",
    Tolerance=1e-06,
    Component="{ .SnapEndsToGrids")

# ---- group: OUTPUTS
snapped_bhom_elements = Data(snapendstogrids)

# ----
snapped_bhom_elements_2 = Data(snapped_bhom_elements)
