# Grasshopper definition connection_forces_factory.gh (Grasshopper 1.0.7)
# plug-ins: BH.UI.Grasshopper, HDTTreeUtils, MetaHopper

uls_lc_identifiers = Data()
pull_cfs_trigger = Data()
scaling_factor = Data()
bhom_bars = BHoMObject()
id_pattern = Data()
tolerance = Data()
rounding = Data()
adapter = Data()

# ---- group: INPUTS
uls_lc_identifiers_2 = Data(uls_lc_identifiers)
pull_cfs_trigger_2 = Data(pull_cfs_trigger)
scaling_factor_2 = Data(scaling_factor)
bhom_bars_2 = BHoMObject(
    bhom_bars,
    ObjectType="{ \"_t\" : \"System.Type\", \"Name\" : \"System.Object, mscorlib, Version=4.0.0.0, Culture=neutral, PublicKeyToken=b77a5c561934e089\", \"_bhomVersion\" : \"8.1\" }",
    m_ForcePreview=False,
    m_MaxItemsPreview=10000)
id_pattern_2 = Data(id_pattern)
tolerance_2 = Data(tolerance)
rounding_2 = Data(rounding)
adapter_2 = Data(adapter)

# ---- group: COMPUTE CONNECTION FORCES
# SUPERSEDED
group_toggle = GroupToggle(ToggleActive=True, ToggleVisible=False)  # disabled
ghpython_script = GhPythonScript()  # -> connectionForces; inputs barObjects: list, barEndForces: list
# ---------- ghpython_script: Python ----------
"""Provides a scripting component.
    Inputs:
        barObjects: bhom bar objects
        barEndForces: bhom bar force objects
        scalingFactor: factor scaling up forces values
        Rounding: increment integer value for rounding forces values
    Output:
        a: The a output variable"""

__author__ = "galbieri"
__version__ = "2023.11.14"

'IMPORT LIBRARIES'
import rhinoscriptsyntax as rs
import ghpythonlib.components as ghcomp
import ghpythonlib.treehelpers as tr
import math as math

'VARIABLES DECLARATION'
forces=[]
forcesNames=["FX","FY","FZ","MX","MY","MZ"]
connectionForces=[]

#Extract Forces
for barEndForce in barEndForces:
    subList=[]
    for forceName in forcesNames:
        subList.append(ghcomp.BH.GetProperty(barEndForce,forceName))
    forces.append(subList)

# Round-up Forces based on input scaling factor and rounding step   
for i in range(0,len(forces),1):
    for j in range(0,len(forces[i]),1):
        if double(forces[i][j])>double(tolerance):
            forces[i][j]='{:.1f}'.format(math.copysign(1,forces[i][j])*
            math.ceil(abs(float(forces[i][j])/1000*
            (1+scalingFactor/100)/rounding))*rounding)
        else:
            forces[i][j]='{:.1f}'.format(double(0))           

# Create BHoM Custom Connection Forces Objects
for i in range(0,len(barEndForces),1):
    bhCustomObj=ghcomp.BH.CreateCustom()
    objectId=ghcomp.BH.GetProperty(barEndForces[i],"ObjectId")
    resultCase=ghcomp.BH.GetProperty(barEndForces[i],"ResultCase")
    position=ghcomp.BH.GetProperty(barEndForces[i],"Position")
    bhCustomObj=ghcomp.BH.SetProperty(bhCustomObj,"ObjectId",objectId)
    bhCustomObj=ghcomp.BH.SetProperty(bhCustomObj,"LoadCombo",resultCase)
    bhCustomObj=ghcomp.BH.SetProperty(bhCustomObj,"Position",position)
    for barObj in barObjects:
        barFragment=ghcomp.FlattenTree(ghcomp.CleanTree(True,True,True,
            ghcomp.BH.GetProperty(barObj,"Fragments")))
        barFragment=ghcomp.BH.GetProperty(barObj,"Fragments")
        barObjId=str(ghcomp.BH.GetProperty(barFragment,"Id"))
        if str(objectId)==str(barObjId):
            startNode=ghcomp.BH.GetProperty(barObj,"StartNode")
            startNodeId=str(ghcomp.BH.GetProperty(barObj,"StartNode.Fragments.Id"))
            endNode=ghcomp.BH.GetProperty(barObj,"EndNode")
            endNodeId=str(ghcomp.BH.GetProperty(barObj,"EndNode.Fragments.Id"))
            if position<0.5:
                bhCustomObj=ghcomp.BH.SetProperty(bhCustomObj,"Node",startNode)
                bhCustomObj=ghcomp.BH.SetProperty(bhCustomObj,"NodeId",startNodeId)
            else:
                bhCustomObj=ghcomp.BH.SetProperty(bhCustomObj,"Node",endNode)    
                bhCustomObj=ghcomp.BH.SetProperty(bhCustomObj,"NodeId",endNodeId)
    for k in range(0,len(forcesNames),1):
        bhCustomObj=ghcomp.BH.SetProperty(bhCustomObj,forcesNames[k],forces[i][k])
    connectionForces.append(bhCustomObj)
# ---------- end ghpython_script ----------

# ---- group: COMPUTE CONNECTION FORCES / LCOMBO PATTERNS AND PULL TRIGGER BRANCHING
# LCOMBO PATTERNS
# AND PULL TRIGGER
# BRANCHING
id_types = Panel("""*ETABSId*
*RobotId*
*GSAId*""")
id_pattern_3 = Data(id_pattern_2)
text = Text(id_pattern_3)
text_2 = Text(id_types)
member_index = MemberIndex(Set=text_2, Member=text)  # -> Index, Count
pull_cfs_trigger_3 = Data(pull_cfs_trigger_2)
idgate = Data(member_index.Index)
idgate_2 = Data(idgate)
stream_gate = StreamGate(Stream=pull_cfs_trigger_3, Gate=idgate_2)  # -> Target0, Target1, Target2
etabs_pull_trigger = Data(stream_gate.Target0)
robot_pull_trigger = Data(stream_gate.Target1)
gsa_pull_trigger = Data(stream_gate.Target2)

# ---- group: COMPUTE CONNECTION FORCES / PULL LOAD COMBINATIONS
# PULL
# LOAD
# COMBINATIONS
data_dam = DataDam(DataDataA=[etabs_pull_trigger, robot_pull_trigger], BufferDelay=10000000, BufferMode=2)
createtype = CreateType(Component="BH.oM.Structure.Loads.LoadCombination")
group_toggle_2 = GroupToggle(ToggleActive=True, ToggleVisible=False)  # disabled
filterrequest = FilterRequest(Type=createtype, Component="{ .FilterRequest")
adapter_3 = Data(adapter_2)
pull_trigger = Data(data_dam)
pull = Pull(
    Adapter=adapter_3,
    Request=filterrequest,
    PullType="{ \"_t\" : \"System.Enum\", \"TypeName\" : { \"_t\" : \"System.Type\", \"Name\" : \"BH.oM.Adapter.PullType\", \"_bhomVersion\" : \"8.1\" }, \"Value\" : \"AdapterDefault\", \"_bhomVersion\" : \"8.1\" }",
    Active=pull_trigger,
    Component="{ .Pull")
uls_lc_identifiers_3 = Data(uls_lc_identifiers_2)
load_combos = BHoMObject(
    pull,
    ObjectType="{ \"_t\" : \"System.Type\", \"Name\" : \"System.Object, mscorlib, Version=4.0.0.0, Culture=neutral, PublicKeyToken=b77a5c561934e089\", \"_bhomVersion\" : \"8.1\" }",
    m_ForcePreview=False,
    m_MaxItemsPreview=10000)
getproperty = GetProperty(Obj=load_combos, PropName="Name", Component="{ .GetProperty")
combo_patterns = Data(graft(uls_lc_identifiers_3))
match_text = MatchText(Text=getproperty, Pattern=combo_patterns, Case=True)  # -> simplify(Match)
cull_pattern = CullPattern(List=load_combos, CullPattern=match_text)  # -> simplify(List)
load_combos_2 = Data(flatten(cull_pattern))

# ---- group: COMPUTE CONNECTION FORCES / LCOMBOS BRANCHING
# LCOMBOS
# BRANCHING
etabs_load_combos = Data(load_combos_2)
robot_load_combos = Data(load_combos_2)
gsa_lcombo_names = Data(uls_lc_identifiers_3)
idgate_3 = Data(idgate)
stream_filter = StreamFilter(Gate=idgate_3, Stream0=etabs_load_combos, Stream1=robot_load_combos, Stream2=gsa_lcombo_names)
load_combos_3 = Data(simplify(stream_filter))

# ---- group: COMPUTE CONNECTION FORCES / PULL BARS INTERNAL FORCES
# PULL
# BARS
# INTERNAL
# FORCES
panel = Panel("Fragments")
bhom_bars_3 = BHoMObject(
    bhom_bars_2,
    ObjectType="{ \"_t\" : \"System.Type\", \"Name\" : \"System.Object, mscorlib, Version=4.0.0.0, Culture=neutral, PublicKeyToken=b77a5c561934e089\", \"_bhomVersion\" : \"8.1\" }",
    m_ForcePreview=False,
    m_MaxItemsPreview=10000)
getproperty_2 = GetProperty(Obj=bhom_bars_3, PropName=panel, Component="{ .GetProperty")
id_pattern_4 = Data(id_pattern_2)
group_toggle_3 = GroupToggle(ToggleActive=True, ToggleVisible=False)  # disabled
match_text_2 = MatchText(Text=getproperty_2, Pattern=id_pattern_4, Case=True)
getproperty_3 = GetProperty(Obj=getproperty_2, PropName="Id", Component="{ .GetProperty")
cull_pattern_2 = CullPattern(List=getproperty_3, CullPattern=match_text_2)
barresulttype = BarResultType(
    {"BarForce": 0, "BarDeformation": 1, "BarStress": 2, "BarStrain": 3, "BarDisplacement": 4, "BarModeShape": 5}, selected="BarForce",
    Component="BH.oM.Structure.Requests.BarResultType",
    Selection=0)
divisiontype = DivisionType(
    {"EvenlyDistributed": 0, "ExtremeValues": 1}, selected="EvenlyDistributed",
    Component="BH.oM.Structure.Requests.DivisionType",
    Selection=0)
load_combos_4 = Data(simplify(graft(load_combos_3)))
ids = Data(flatten(cull_pattern_2))
pull_trigger_2 = Data([etabs_pull_trigger, robot_pull_trigger, gsa_pull_trigger])
barresultrequest = BarResultRequest(
    ResultType=barresulttype,
    DivisionType=divisiontype,
    Divisions=Slider(2, range=0..100),
    Cases=load_combos_4,
    ObjectIds=ids,
    Component="{ .BarResultRequest")
data_dam_2 = DataDam(DataDataA=pull_trigger_2, BufferDelay=20000000, BufferMode=2)
adapter_4 = Data(adapter_2)
pull_2 = Pull(
    Adapter=adapter_4,
    Request=barresultrequest,
    PullType="{ \"_t\" : \"System.Enum\", \"TypeName\" : { \"_t\" : \"System.Type\", \"Name\" : \"BH.oM.Adapter.PullType\", \"_bhomVersion\" : \"8.1\" }, \"Value\" : \"AdapterDefault\", \"_bhomVersion\" : \"8.1\" }",
    Active=data_dam_2,
    Component="{ .Pull")
bar_forces = BHIObject(
    simplify(pull_2),
    ObjectType="{ \"_t\" : \"System.Type\", \"Name\" : \"System.Object, mscorlib, Version=4.0.0.0, Culture=neutral, PublicKeyToken=b77a5c561934e089\", \"_bhomVersion\" : \"8.1\" }",
    m_ForcePreview=False,
    m_MaxItemsPreview=10000)

# ---- group: COMPUTE CONNECTION FORCES / EXTRACT BAR END FORCES ONLY
# EXTRACT
# BAR
# END FORCES
# ONLY
group_toggle_4 = GroupToggle(ToggleActive=True, ToggleVisible=False)  # disabled
bar_forces_2 = BHIObject(
    simplify(bar_forces),
    ObjectType="{ \"_t\" : \"System.Type\", \"Name\" : \"System.Object, mscorlib, Version=4.0.0.0, Culture=neutral, PublicKeyToken=b77a5c561934e089\", \"_bhomVersion\" : \"8.1\" }",
    m_ForcePreview=False,
    m_MaxItemsPreview=10000)
getproperty_4 = GetProperty(Obj=bar_forces_2, PropName="ObjectId", Component="{ .GetProperty")  # -> simplify(Value)
create_set = CreateSet(List=getproperty_4)  # -> Set, Map
bar_forces_3 = BHIObject(
    simplify(bar_forces_2),
    ObjectType="{ \"_t\" : \"System.Type\", \"Name\" : \"System.Object, mscorlib, Version=4.0.0.0, Culture=neutral, PublicKeyToken=b77a5c561934e089\", \"_bhomVersion\" : \"8.1\" }",
    m_ForcePreview=False,
    m_MaxItemsPreview=10000)
graft_by_data = GraftByData(InputData=bar_forces_3, PathsToAssign=create_set.Map)
panel_2 = Panel("""0
-1""")
list_item = ListItem(List=graft_by_data, Index=panel_2, Wrap=True)
bar_end_forces = BHIObject(
    simplify(list_item),
    ObjectType="{ \"_t\" : \"System.Type\", \"Name\" : \"System.Object, mscorlib, Version=4.0.0.0, Culture=neutral, PublicKeyToken=b77a5c561934e089\", \"_bhomVersion\" : \"8.1\" }",
    m_ForcePreview=False,
    m_MaxItemsPreview=10000)

# ---- group: COMPUTE CONNECTION FORCES / SCALE AND FACTOR THE BAR END FORCES
# SCALE AND FACTOR
# THE BAR END FORCES
bar_end_forces_2 = BHIObject(
    simplify(flatten(bar_end_forces)),
    ObjectType="{ \"_t\" : \"System.Type\", \"Name\" : \"System.Object, mscorlib, Version=4.0.0.0, Culture=neutral, PublicKeyToken=b77a5c561934e089\", \"_bhomVersion\" : \"8.1\" }",
    m_ForcePreview=False,
    m_MaxItemsPreview=10000)
scaling_factor_3 = Data(scaling_factor_2)
bhom_bars_4 = BHoMObject(
    bhom_bars_2,
    ObjectType="{ \"_t\" : \"System.Type\", \"Name\" : \"System.Object, mscorlib, Version=4.0.0.0, Culture=neutral, PublicKeyToken=b77a5c561934e089\", \"_bhomVersion\" : \"8.1\" }",
    m_ForcePreview=False,
    m_MaxItemsPreview=10000)
id_pattern_5 = Data(id_pattern_2)
tolerance_3 = Data(tolerance_2)
rounding_3 = Data(rounding_2)
cluster = Cluster_4(
    bar_end_forces=bar_end_forces_2,
    bhom_bars=bhom_bars_4,
    id_pattern=id_pattern_5,
    tolerance_kn=tolerance_3,
    rounding=rounding_3,
    scaling_factor=scaling_factor_3)
group_toggle_5 = GroupToggle(ToggleActive=True, ToggleVisible=False)  # disabled
connectionforces = Data(cluster)

# ---- group: COMPUTE CONNECTION FORCES / REMAP CONNECTION FORCES DATA STRUCTURE
# REMAP
# CONNECTION FORCES
# DATA STRUCTURE
bar_end_forces_3 = BHIObject(
    simplify(graft(bar_end_forces)),
    ObjectType="{ \"_t\" : \"System.Type\", \"Name\" : \"System.Object, mscorlib, Version=4.0.0.0, Culture=neutral, PublicKeyToken=b77a5c561934e089\", \"_bhomVersion\" : \"8.1\" }",
    m_ForcePreview=False,
    m_MaxItemsPreview=10000)
connectionforces_2 = Data(simplify(graft(connectionforces)))
group_toggle_6 = GroupToggle(ToggleActive=True, ToggleVisible=False)  # disabled
tree_statistics = TreeStatistics(Tree=connectionforces_2)  # -> Paths, Length, Count
tree_statistics_2 = TreeStatistics(Tree=bar_end_forces_3)  # -> Paths, Length, Count
replace_paths = ReplacePaths(Data=connectionforces_2, Search=tree_statistics.Paths, Replace=tree_statistics_2.Paths)
trim_tree = TrimTree(Tree=replace_paths, Depth=1)
connectionforces_3 = Data(trim_tree)

# ---- group: OUTPUTS
connectionforces_4 = Data(connectionforces_3)

# ----
connectionforces_5 = Data(connectionforces_4)

# ==== cluster Cluster_4
bar_end_forces = ClusterInput()
tolerance_kn = ClusterInput()
scaling_factor = ClusterInput()
bhom_bars = ClusterInput()
rounding = ClusterInput()
id_pattern = ClusterInput()
bar_end_forces_2 = BHIObject(
    simplify(flatten(bar_end_forces)),
    ObjectType="{ \"_t\" : \"System.Type\", \"Name\" : \"System.Object, mscorlib, Version=4.0.0.0, Culture=neutral, PublicKeyToken=b77a5c561934e089\", \"_bhomVersion\" : \"8.1\" }",
    m_ForcePreview=False,
    m_MaxItemsPreview=10000)
tolerance_kn_2 = Data(tolerance_kn)
scaling_factor_2 = Data(scaling_factor)
bhom_bars_2 = BHoMObject(
    bhom_bars,
    ObjectType="{ \"_t\" : \"System.Type\", \"Name\" : \"System.Object, mscorlib, Version=4.0.0.0, Culture=neutral, PublicKeyToken=b77a5c561934e089\", \"_bhomVersion\" : \"8.1\" }",
    m_ForcePreview=False,
    m_MaxItemsPreview=10000)
rounding_2 = Data(rounding)
id_pattern_2 = Data(id_pattern)
cluster = Cluster_2(bar_end_forces=bar_end_forces_2, bhom_bars=bhom_bars_2, id_pattern=id_pattern_2)  # -> nodes_2, releases_5
releases = Data(cluster.releases_5)
nodes = Data(cluster.nodes_2)
explode = Explode(Object=simplify(graft(releases)), Component="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")  # -> TranslationX, TranslationY, TranslationZ, RotationX, RotationY, RotationZ
cluster_2 = Cluster(bar_end_forces=bar_end_forces_2, tolerance_kn=tolerance_kn_2, rounding=rounding_2, scaling_factor=scaling_factor_2)
merge = Merge(
    Data1=explode.TranslationX,
    Data2=explode.TranslationY,
    Data3=explode.TranslationZ,
    Data4=explode.RotationX,
    Data5=explode.RotationY,
    Data6=explode.RotationZ)
nodes_2 = Data(nodes)
releases_2 = Data(merge)
forces = Data(cluster_2)
getproperty = GetProperty(Obj=nodes_2, PropName="Fragments.Id", Component="{ .GetProperty")  # -> flatten(Value)
explode_2 = Explode(Object=bar_end_forces_2, Component="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")  # -> ObjectId, ResultCase, Position
panel = Panel("""Free
Fixed""")
text = Text(releases_2)
panel_2 = Panel("""f
x""")
cluster_3 = Cluster_3(forces=forces, releases=releases_2)
nodeids = Data(getproperty)
replace_members = ReplaceMembers(Set=text, Find=panel, Replace=panel_2)
flip_matrix = FlipMatrix(Data=cluster_3)
text_join = TextJoin(Text=replace_members)
explode_tree = ExplodeTree(Data=flip_matrix)  # -> Branch0, Branch1, Branch2, Branch3, Branch4, Branch5
releases_3 = Data(flatten(text_join))
fx = Data(explode_tree.Branch0)
fy = Data(explode_tree.Branch1)
fz = Data(explode_tree.Branch2)
mx = Data(explode_tree.Branch3)
mz = Data(explode_tree.Branch5)
my = Data(explode_tree.Branch4)
nodeids_2 = Data(nodeids)
releases_4 = Data(releases_3)
fx_2 = Data(fx)
my_2 = Data(my)
mz_2 = Data(mz)
nodes_3 = Data(nodes)
fy_2 = Data(fy)
fz_2 = Data(fz)
mx_2 = Data(mx)
custom_connection_forces = CreateCustom(
    ObjectId=explode_2.ObjectId,
    LoadCombo=explode_2.ResultCase,
    Position=explode_2.Position,
    Node=nodes_3,
    NodeId=nodeids_2,
    Release=releases_4,
    FX=fx_2,
    FY=fy_2,
    FZ=fz_2,
    MX=mx_2,
    MY=my_2,
    MZ=mz_2,
    Component="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")
connectionforces = Data(custom_connection_forces)
connectionforces_2 = ClusterOutput(connectionforces)

# ==== cluster Cluster
bar_end_forces = ClusterInput()
tolerance_kn = ClusterInput()
scaling_factor = ClusterInput()
rounding = ClusterInput()

# ---- group: INPUTS
bar_end_forces_2 = Data(bar_end_forces)
tolerance_kn_2 = Data(tolerance_kn)
scaling_factor_2 = Data(scaling_factor)
rounding_2 = Data(rounding)

# ---- group: EXTRACT BARFORCE ATTRIBUTES' VALUES
explode = Explode(Object=bar_end_forces_2, Component="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")  # -> FX, FY, FZ, MX, MY, MZ
merge = Merge(
    Data1=simplify(graft(explode.FX)),
    Data2=simplify(graft(explode.FY)),
    Data3=simplify(graft(explode.FZ)),
    Data4=simplify(graft(explode.MX)),
    Data5=simplify(graft(explode.MY)),
    Data6=simplify(graft(explode.MZ)))

# ---- group: SEPARATE FORCES <> THAN TOLERANCE
division = Division(A=merge, B="1000")
absolute = Absolute(Value=division)
tolerance_kn_3 = Data(tolerance_kn_2)
larger_than = LargerThan(FirstNumber=absolute, SecondNumber=tolerance_kn_3)  # -> LargerThan, OrEqualTo
sift_pattern = SiftPattern(List=division, SiftPattern=larger_than.LargerThan)  # -> Output0, Output1

# ---- group: FORCES > THAN TOLERANCE -> SCALE AND ROUND UP
forces_tolerance = Data(sift_pattern.Output1)
scaling_factor_3 = Data(scaling_factor_2)
rounding_3 = Data(rounding_2)
division_2 = Division(A=scaling_factor_3, B="100")
addition = Addition(A="1", B=division_2)
forces = Data(forces_tolerance)
multiplication = Multiplication(A=forces, B=addition)
rounding_4 = Data(rounding_3)
division_3 = Division(A=multiplication, B=rounding_4)
absolute_2 = Absolute(Value=division_3)
forces_2 = Data(forces_tolerance)
round_to_decimal_place = RoundToDecimalPlace(NumberX=absolute_2, DecimalPlace="0", RoundType="2")  # -> Rounded, Difference
absolute_3 = Absolute(Value=forces_2)
division_4 = Division(A=forces_2, B=absolute_3)
multiplication_2 = Multiplication(A=division_4, B=round_to_decimal_place.Rounded)
rounding_5 = Data(rounding_4)
multiplication_3 = Multiplication(A=multiplication_2, B=rounding_5)
forces_tolerance_2 = Data(multiplication_3)

# ---- group: FORCES < THAN TOLERANCE -> ROUND TO ZERO
forces_tolerance_3 = Data(sift_pattern.Output0)
null_item = NullItem(Item=forces_tolerance_3)  # -> NullFlags, InvalidFlags, Description
list_indices = ListIndices(List=forces_tolerance_3)
gate_not = GateNot(A=null_item.NullFlags)
cull_pattern = CullPattern(List=list_indices, CullPattern=gate_not)
replace_items = ReplaceItems(List=forces_tolerance_3, Item="0", Indices=cull_pattern, Wrap=False)
forces_tolerance_4 = Data(replace_items)

# ---- group: COMBINE FORCES INTO SINGLE DATA TREE STRUCTURE
forces_tolerance_5 = Data(forces_tolerance_2)
forces_tolerance_6 = Data(forces_tolerance_4)
combine_data = CombineData(Input0=forces_tolerance_6, Input1=forces_tolerance_5)  # -> Result, Index
roundedforces = Data(combine_data.Result)

# ----
roundedforces_2 = Data(simplify(roundedforces))
roundedforces_3 = ClusterOutput(roundedforces_2)

# ==== cluster Cluster_2
bar_end_forces = ClusterInput()
bhom_bars = ClusterInput()
id_pattern = ClusterInput()
bhom_bars_2 = BHoMObject(
    bhom_bars,
    ObjectType="{ \"_t\" : \"System.Type\", \"Name\" : \"System.Object, mscorlib, Version=4.0.0.0, Culture=neutral, PublicKeyToken=b77a5c561934e089\", \"_bhomVersion\" : \"8.1\" }",
    m_ForcePreview=False,
    m_MaxItemsPreview=10000)
bar_end_forces_2 = BHIObject(
    bar_end_forces,
    ObjectType="{ \"_t\" : \"System.Type\", \"Name\" : \"System.Object, mscorlib, Version=4.0.0.0, Culture=neutral, PublicKeyToken=b77a5c561934e089\", \"_bhomVersion\" : \"8.1\" }",
    m_ForcePreview=False,
    m_MaxItemsPreview=10000)
id_pattern_2 = Data(id_pattern)
getproperty = GetProperty(Obj=bhom_bars_2, PropName="Start", Component="{ .GetProperty")
getproperty_2 = GetProperty(Obj=bhom_bars_2, PropName="End", Component="{ .GetProperty")
getproperty_3 = GetProperty(Obj=bhom_bars_2, PropName="Release", Component="{ .GetProperty")
getproperty_4 = GetProperty(Obj=bhom_bars_2, PropName="Fragments", Component="{ .GetProperty")
fragments = Data(simplify(getproperty_4))
startnodes = Data(getproperty)
endnodes = Data(getproperty_2)
releases = Data(getproperty_3)
getproperty_5 = GetProperty(Obj=bar_end_forces_2, PropName="ObjectId", Component="{ .GetProperty")
id_pattern_3 = Data(id_pattern_2)
getproperty_6 = GetProperty(Obj=fragments, PropName="Id", Component="{ .GetProperty")
match_text = MatchText(Text=fragments, Pattern=id_pattern_3, Case=True)
barreleasefixfix = BarReleaseFixFix(Name="FixFix", Component="{ .BarReleaseFixFix")
barendforceobjids = Data(getproperty_5)
replace_nulls = ReplaceNulls(Items=releases, Replacements=barreleasefixfix)  # -> Items, Count
cull_pattern = CullPattern(List=getproperty_6, CullPattern=match_text)
getproperty_7 = GetProperty(Obj=bar_end_forces_2, PropName="Position", Component="{ .GetProperty")
barendforceobjids_2 = Data(barendforceobjids)
barendforceobjids_3 = Data(barendforceobjids)
barendforceobjids_4 = Data(barendforceobjids)
barobjids = Data(flatten(cull_pattern))
barobjids_2 = Data(flatten(cull_pattern))
barobjids_3 = Data(flatten(cull_pattern))
larger_than = LargerThan(FirstNumber=getproperty_7, SecondNumber="0.5")  # -> LargerThan, OrEqualTo
startnodes_2 = Data(startnodes)
endnodes_2 = Data(endnodes)
releases_2 = Data(replace_nulls.Items)
key_value_search = KeyValueSearch(Keys=barobjids, Values=releases_2, Search=barendforceobjids_2)
key_value_search_2 = KeyValueSearch(Keys=barobjids_2, Values=endnodes_2, Search=barendforceobjids_3)
key_value_search_3 = KeyValueSearch(Keys=barobjids_3, Values=startnodes_2, Search=barendforceobjids_4)
startnodes_3 = Data(key_value_search_3)
endnodes_3 = Data(key_value_search_2)
releases_3 = Data(key_value_search)
explode = Explode(Object=releases_3, Component="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")  # -> StartRelease, EndRelease
startrelease = Data(explode.StartRelease)
startnodes_4 = Data(startnodes_3)
endrelease = Data(explode.EndRelease)
endnodes_4 = Data(endnodes_3)
pick_n_choose = PickNChoose(Pattern=larger_than.LargerThan, Stream0=startrelease, Stream1=endrelease)
pick_n_choose_2 = PickNChoose(Pattern=larger_than.LargerThan, Stream0=startnodes_4, Stream1=endnodes_4)
releases_4 = Data(pick_n_choose)
nodes = Data(pick_n_choose_2)
releases_5 = ClusterOutput(releases_4)
nodes_2 = ClusterOutput(nodes)

# ==== cluster Cluster_3
releases = ClusterInput()
forces = ClusterInput()
releases_2 = Text(releases)
forces_2 = Data(forces)
member_index = MemberIndex(Set=releases_2, Member="Free")  # -> Index, Count
replace_items = ReplaceItems(List=forces_2, Item="0", Indices=member_index.Index, Wrap=False)
forces_3 = Data(simplify(replace_items))
forces_4 = ClusterOutput(forces_3)
