# Grasshopper definition dynamic_tree_trimmer.gh (Grasshopper 1.0.7)

untrimmed_tree = Data()
untrimmed_tree_2 = Data(untrimmed_tree)
tree_statistics = TreeStatistics(Tree=untrimmed_tree_2)  # -> Paths, Length, Count
deconstruct_path = DeconstructPath(Branch=tree_statistics.Paths)  # -> simplify(flatten(Indices))
list_length = ListLength(List=deconstruct_path)
division = Division(A=list_length, B=tree_statistics.Count)
trim_tree = TrimTree(Tree=untrimmed_tree_2, Depth=expr("x-1", division))
trimmed_tree = Data(trim_tree)
trimmed_tree_2 = Data(trimmed_tree)
