# Grasshopper definition postgresql_query_script.gh (Grasshopper 1.0.7)

# PostgreSQL Query
sql_query = Panel("SELECT * FROM gst_beamforces")
c_script = CSharpScript(
    query=sql_query,
    trigger=Toggle(True),
    Reference="C:\Users\galbieri\source\repos\TestPostgreSQL\packages\Npgsql.4.0.17\lib\net451\Npgsql.dll")  # -> out, data; inputs query: String, trigger: Boolean
# ---------- c_script: C# usings ----------
using Npgsql;
# ---------- c_script: C# ----------
    if (!trigger) return;

    string connString = "Host=localhost;Port=5432;Username=postgres;Password=Burjkhalifa828@()@;Database=buroHappold";
    List<string> output = new List<string>();

    try
    {
      NpgsqlConnection connection = new NpgsqlConnection(connString);

      connection.Open();
      NpgsqlCommand cmd = new NpgsqlCommand(query, connection);
      NpgsqlDataReader reader = cmd.ExecuteReader();

      while (reader.Read())
      {
        var row = "";
        for (int i = 0; i < reader.FieldCount; i++)
          row += reader.GetValue(i).ToString() + (i < reader.FieldCount - 1 ? ", " : "");
        output.Add(row);
      }
    }
    catch (Exception ex)
    {
      Console.WriteLine("Error: " + ex.Message);
    }

    results = output;
    return;
# ---------- end c_script ----------
# NEVER USE PANELS TO DISPLAY
# THE OUTPUT DATA!!
# IT WILL TAKE FOREVER!
# USE ONLY THE DATA-VIEWER!!
data = Data(c_script.data)
