# Grasshopper definition postgresql_query_snippet.gh (Grasshopper 1.0.7)

sql_query = Panel("SELECT * FROM gst_hyperflex")
# PostgreSQL Query
postgresql_connection_string = Panel("Host=localhost;Port=5432;Username=postgres;Password=Burjkhalifa828@()@;Database=buroHappold")
# EVEN WITH MILLIONS OF PIECES OF DATA IN IT,
# THIS SCRIPT CAN BE SAVED IN NO TIME.
# NO FREEZING, NO CRASHING, NO PAIN....
# IT DOES THE JOB! AND IT DOES IT FAST!
boolean_toggle = BooleanToggle(False)
c_script = CSharpScript(
    connString=postgresql_connection_string,
    query=sql_query,
    trigger=boolean_toggle,
    Reference=["C:\Users\galbieri\Downloads\npgsql.4.1.14\lib\netstandard2.0\Npgsql.dll", "C:\Windows\Microsoft.NET\Framework64\v4.0.30319\netstandard.dll", "C:\Windows\Microsoft.NET\Framework64\v4.0.30319\System.Data.Common.dll"])  # -> data; inputs connString: String, query: String, trigger: Boolean
# ---------- c_script: C# usings ----------
using Npgsql;
# ---------- c_script: C# ----------
    if (!trigger) return;

    List<string> output = new List<string>();

    try
    {
      NpgsqlConnection connection = new NpgsqlConnection(connString);

      connection.Open();
      NpgsqlCommand cmd = new NpgsqlCommand(query, connection);
      NpgsqlDataReader reader = cmd.ExecuteReader();

      while (reader.Read())
      {
        var row = "";
        for (int i = 0; i < reader.FieldCount; i++)
          row += reader.GetValue(i).ToString() + (i < reader.FieldCount - 1 ? ", " : "");
        output.Add(row);
      }
    }
    catch (Exception ex)
    {
      Console.WriteLine("Error: " + ex.Message);
    }

    data = output;
    return;
# ---------- end c_script ----------
# NEVER USE PANELS TO DISPLAY
# THE OUTPUT DATA!!
# IT WILL TAKE FOREVER!
# USE ONLY THE DATA-VIEWER!!
data = Data(c_script)
text_split = TextSplit(Text=data, Separators=",")  # -> simplify(Result)
flip_matrix = FlipMatrix(Data=text_split)
explode_tree = ExplodeTree(Data=flip_matrix)  # -> Branch0, Branch1, Branch2, Branch3, Branch4, Branch5, Branch6, Branch7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
