# Grasshopper definition revit_walls_laundry.gh (Grasshopper 1.0.7)
# plug-ins: BH.UI.Grasshopper

rc_decimal_places = Data()
stg_max_angle = Data()
rs_min_area_m2 = Data()
sth_max_dist_m = Data()
stg_max_dist_m = Data()
revit_walls = BHoMObject()
grids = BHoMObject()
levels = BHoMObject()

# ---- group: INPUTS
rc_decimal_places_2 = Data(rc_decimal_places)
stg_max_angle_2 = Data(stg_max_angle)
rs_min_area_m2_2 = Data(rs_min_area_m2)
sth_max_dist_m_2 = Data(sth_max_dist_m)
stg_max_dist_m_2 = Data(stg_max_dist_m)
revit_walls_2 = BHoMObject(
    revit_walls,
    ObjectType="{ \"_t\" : \"System.Type\", \"Name\" : \"System.Object, mscorlib, Version=4.0.0.0, Culture=neutral, PublicKeyToken=b77a5c561934e089\", \"_bhomVersion\" : \"8.2\" }",
    m_ForcePreview=False,
    m_MaxItemsPreview=10000)
grids_2 = BHoMObject(
    grids,
    ObjectType="{ \"_t\" : \"System.Type\", \"Name\" : \"System.Object, mscorlib, Version=4.0.0.0, Culture=neutral, PublicKeyToken=b77a5c561934e089\", \"_bhomVersion\" : \"8.2\" }",
    m_ForcePreview=False,
    m_MaxItemsPreview=10000)
levels_2 = BHoMObject(
    levels,
    ObjectType="{ \"_t\" : \"System.Type\", \"Name\" : \"System.Object, mscorlib, Version=4.0.0.0, Culture=neutral, PublicKeyToken=b77a5c561934e089\", \"_bhomVersion\" : \"8.2\" }",
    m_ForcePreview=False,
    m_MaxItemsPreview=10000)

# ----
# MODEL LAUNDRY
# Split
# Snap To Heights
# Remove Small
# Snap To Grids
levels_3 = BHoMObject(
    levels_2,
    ObjectType="{ \"_t\" : \"System.Type\", \"Name\" : \"System.Object, mscorlib, Version=4.0.0.0, Culture=neutral, PublicKeyToken=b77a5c561934e089\", \"_bhomVersion\" : \"8.2\" }",
    m_ForcePreview=False,
    m_MaxItemsPreview=10000)
explode = Explode(Object=levels_3, Component="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")  # -> Name, Elevation, BHoM_Guid, Fragments, Tags, CustomData
unit_z = UnitZ(Factor=explode.Elevation)
xy_plane = XYPlane(Origin=unit_z)
revit_walls_3 = BHoMObject(
    revit_walls_2,
    ObjectType="{ \"_t\" : \"System.Type\", \"Name\" : \"System.Object, mscorlib, Version=4.0.0.0, Culture=neutral, PublicKeyToken=b77a5c561934e089\", \"_bhomVersion\" : \"8.2\" }",
    m_ForcePreview=False,
    m_MaxItemsPreview=10000)
split = Split(Element2D=revit_walls_3, Planes=xy_plane, Tolerance=1e-06, Component="{ .Split")  # -> flatten(Elements)
sth_max_dist_m_3 = Data(sth_max_dist_m_2)
snaptoheights = SnapToHeights(
    Element2D=split,
    RefHeights=explode.Elevation,
    MaxDistance=sth_max_dist_m_3,
    AllowNonPlanar=False,
    Component="{ .SnapToHeights")
rs_min_area_m2_3 = Data(rs_min_area_m2_2)
removesmall = RemoveSmall(Elements2D=snaptoheights, MinAreaTotal=rs_min_area_m2_3, MinAreaInternal=0, Component="{ .RemoveSmall")
stg_max_angle_3 = Data(stg_max_angle_2)
stg_max_dist_m_3 = Data(stg_max_dist_m_2)
grids_3 = BHoMObject(
    grids_2,
    ObjectType="{ \"_t\" : \"System.Type\", \"Name\" : \"System.Object, mscorlib, Version=4.0.0.0, Culture=neutral, PublicKeyToken=b77a5c561934e089\", \"_bhomVersion\" : \"8.2\" }",
    m_ForcePreview=False,
    m_MaxItemsPreview=10000)
snaptogrids = SnapToGrids(
    Element2D=removesmall,
    Grids=grids_3,
    MaxDistance=stg_max_dist_m_3,
    MaxAngle=stg_max_angle_3,
    AllowNonPlanar=False,
    Tolerance=1e-06,
    Component="{ .SnapToGrids")
rc_decimal_places_3 = Data(rc_decimal_places_2)
roundcoordinates = RoundCoordinates(Element2d=snaptogrids, DecimalPlaces=rc_decimal_places_3, Component="{ .RoundCoordinates")
laundered_revit_walls = BHoMObject(
    roundcoordinates,
    ObjectType="{ \"_t\" : \"System.Type\", \"Name\" : \"System.Object, mscorlib, Version=4.0.0.0, Culture=neutral, PublicKeyToken=b77a5c561934e089\", \"_bhomVersion\" : \"8.2\" }",
    m_ForcePreview=False,
    m_MaxItemsPreview=10000)

# ---- group: OUTPUTS
revit_walls_4 = BHoMObject(
    laundered_revit_walls,
    ObjectType="{ \"_t\" : \"System.Type\", \"Name\" : \"System.Object, mscorlib, Version=4.0.0.0, Culture=neutral, PublicKeyToken=b77a5c561934e089\", \"_bhomVersion\" : \"8.2\" }",
    m_ForcePreview=False,
    m_MaxItemsPreview=10000)

# ---- group: VISUALIZATION
laundered_revit_walls_2 = BHoMObject(
    revit_walls_4,
    ObjectType="{ \"_t\" : \"System.Type\", \"Name\" : \"System.Object, mscorlib, Version=4.0.0.0, Culture=neutral, PublicKeyToken=b77a5c561934e089\", \"_bhomVersion\" : \"8.2\" }",
    m_ForcePreview=False,
    m_MaxItemsPreview=10000)
original_revit_walls = BHoMObject(
    revit_walls_2,
    ObjectType="{ \"_t\" : \"System.Type\", \"Name\" : \"System.Object, mscorlib, Version=4.0.0.0, Culture=neutral, PublicKeyToken=b77a5c561934e089\", \"_bhomVersion\" : \"8.2\" }",
    m_ForcePreview=False,
    m_MaxItemsPreview=10000)
custom_preview = CustomPreview(Geometry=original_revit_walls, Material=ColourSwatch(SwatchColor=RGBA(204, 196, 196, 120)))
custom_preview_2 = CustomPreview(Geometry=laundered_revit_walls_2, Material=ColourSwatch(SwatchColor=RGB(25, 193, 212)))

# ----
revit_walls_5 = BHoMObject(revit_walls_4)
