# Grasshopper definition revitobstojsonviabhom.gh (Grasshopper 1.0.7)
# plug-ins: BH.UI.Grasshopper, MetaHopper

# ----
# 1. PULL REVIT OBJECTS AND
# PUSH INTO JSON FILE
group_toggle = GroupToggle(ToggleActive=True, ToggleVisible=False)  # disabled

# ----
# 1. SET THE FILTERS
# Only the selected Categories...
# Only Model Elements (not Families)...
revit_category_names = Panel("""Structural Columns
Structural Framing
Floors
Levels""")
filterbycategory = FilterByCategory(CategoryName=revit_category_names, CaseSensitive=True, Component="BH.oM.Adapters.Revit.Requests.FilterByCategory")
filtermodelelements = FilterModelElements(Component="BH.oM.Adapters.Revit.Requests.FilterModelElements")
logicalandrequest = LogicalAndRequest(Request1=filterbycategory, Request2=filtermodelelements, Component="{ .LogicalAndRequest")

# ----
# 2. PULL OBJECTS FROM REVIT
boolean_toggle = BooleanToggle(False)
revitadapter = RevitAdapter(Active=boolean_toggle, Component="{ ..ctor")
pull = Pull(
    Adapter=revitadapter,
    Request=logicalandrequest,
    PullType="{ \"_t\" : \"System.Enum\", \"TypeName\" : { \"_t\" : \"System.Type\", \"Name\" : \"BH.oM.Adapter.PullType\", \"_bhomVersion\" : \"8.2\" }, \"Value\" : \"AdapterDefault\", \"_bhomVersion\" : \"8.2\" }",
    Active=Toggle(False),
    Component="{ .Pull")

# ----
# 3. PUSH OBJECTS TO JSON FILE
panel = Panel("Existing TH Revit Model")
trigger = Trigger(Interval=86400000, TimerInterval=86400000, Target=cluster)  # disabled
cluster = Cluster_2(file_name=panel)
pushtype = PushType(
    {"FullPush": 0, "CreateOnly": 1, "CreateNonExisting": 2, "UpdateOnly": 3, "UpdateOrCreateOnly": 4, "DeleteThenCreate": 5, "AdapterDefault": 6}, selected="DeleteThenCreate",
    Component="BH.oM.Adapter.PushType",
    Selection=5)
folder_path = FilePath("C:\Users\galbieri\OneDrive - Buro Happold\Structures\10_Computational\HOI\Revit Model Manipulation\json Backups\")
fileadapter = FileAdapter(Folder=folder_path, FileName=cluster, Component="{ ..ctor")
push = Push(Adapter=fileadapter, Objects=simplify(flatten(pull)), PushType=pushtype, Active=Toggle(False), Component="{ .Push")  # -> Objects, Success

# ==== cluster Cluster_2
file_name = ClusterInput()
time = Time("Now")
file_name_2 = Data(file_name)
deconstruct_date = DeconstructDate(Date=time)  # -> Year, Month, Day, Hour, Minute, Second
year = Data(deconstruct_date.Year)
month = Data(deconstruct_date.Month)
day = Data(deconstruct_date.Day)
cluster = Cluster(number=day)
cluster_2 = Cluster(number=month)
concatenate = Concatenate(Year=year, Month=cluster_2, Day=cluster)
file_name_3 = Data(file_name_2)
date = Data(concatenate)
concatenate_2 = Concatenate(Date=date, Separator="_", File_Name=file_name_3, Extension=".json")
dated_file_name = Data(concatenate_2)
dated_file_name_2 = ClusterOutput(dated_file_name)

# ==== cluster Cluster
number = ClusterInput()
number_2 = Data(number)
text_length = TextLength(Text=number_2)
subtraction = Subtraction(A="2", B=text_length)
duplicate_data = DuplicateData(Data="0", Number=subtraction, Order=True)
number_3 = Data(number_2)
prefix = Data(duplicate_data)
concatenate = Concatenate(FragmentA=prefix, FragmentB=number_3)
full_number = Data(concatenate)
full_number_2 = ClusterOutput(full_number)
