# Grasshopper definition rhino_textdots_updater.gh (Grasshopper 1.0.7)
# plug-ins: EleFront

original_tag_text = Data()
rhino_tags_objs = Data()
new_tag_text = Data()
bake_name = Data()
toggle = Data()

# ---- group: INPUTS
original_tag_text_2 = Data(original_tag_text)
rhino_tags_objs_2 = Data(rhino_tags_objs)
new_tag_text_2 = Data(new_tag_text)
bake_name_2 = Data(bake_name)
toggle_2 = Data(toggle)

# ---- group: EXTRACT TAGS ATTRIBUTES TO REASSIGN THEM TO NEW TAGS
rhino_tags_objs_3 = Data(rhino_tags_objs_2)
get_user_attributes = GetUserAttributes(Geometry=rhino_tags_objs_3)  # -> Keys, Values, flatten(BakeName)
cluster = Cluster(untrimmed_tree=get_user_attributes.Keys)
cluster_2 = Cluster(untrimmed_tree=get_user_attributes.Values)
get_rhino_attributes = GetRhinoAttributes(Geometry=simplify(rhino_tags_objs_3), readFullPath=True)  # -> Name, Layer, Color
text_values = Text(cluster_2)
text_keys = Text(cluster)
define_object_attributes = DefineObjectAttributes(UserKeys=text_keys, UserValues=text_values, Layer=get_rhino_attributes.Layer, Color=get_rhino_attributes.Color)
attributes = Data(define_object_attributes)

# ---- group: REPLACE TAGS TEXT WITH NEW TEXT
rhino_tags_objs_4 = Data(rhino_tags_objs_2)
deconstruct_text = DeconstructText(TextObject=rhino_tags_objs_4)  # -> Text, Plane, Height, Justification
original_tag_text_3 = Data(original_tag_text_2)
new_tag_text_3 = Data(new_tag_text_2)
tags_texts = Data(deconstruct_text.Text)
replace_members = ReplaceMembers(Set=tags_texts, Find=original_tag_text_3, Replace=new_tag_text_3)
text = Text(replace_members)
define_text_dot = DefineTextDot(Text=text, Location=deconstruct_text.Plane, Font="Arial", Size=deconstruct_text.Height)
textdots = Data(define_text_dot)

# ---- group: BAKE UPDATED TAGS INTO RHINO
bake_name_3 = Data(bake_name_2)
attributes_2 = Data(attributes)
textdots_2 = Data(textdots)
toggle_3 = Data(toggle_2)
bake_objects = BakeObjects(Geometry=graft(textdots_2), Attributes=graft(attributes_2), BakeName=bake_name_3, Bake=toggle_3)

# ---- group: CHECK TEXT DOTS AND ATTRIBUTES
index = Slider(4, range=0..5)
path = Slider(3, range=0..5)
attributes_3 = Data(cluster_2)
textdots_3 = Data(textdots_2)
tree_item = TreeItem(Tree=attributes_3, Path=path, Index=index, Wrap=True)
tree_item_2 = TreeItem(Tree=textdots_3, Path=path, Index=index, Wrap=True)
attribute_value = Panel(tree_item)
text_dot_text = Panel(tree_item_2)

# ==== cluster Cluster
untrimmed_tree = ClusterInput()
untrimmed_tree_2 = Data(untrimmed_tree)
tree_statistics = TreeStatistics(Tree=untrimmed_tree_2)  # -> Paths, Length, Count
deconstruct_path = DeconstructPath(Branch=tree_statistics.Paths)  # -> simplify(flatten(Indices))
list_length = ListLength(List=deconstruct_path)
division = Division(A=list_length, B=tree_statistics.Count)
trim_tree = TrimTree(Tree=untrimmed_tree_2, Depth=expr("x-1", division))
trimmed_tree = Data(trim_tree)
trimmed_tree_2 = ClusterOutput(trimmed_tree)
