# Grasshopper definition tree_branches_inspector.gh (Grasshopper 1.0.7)

tree = Data()
branch_index = Data()
tree_2 = Data(tree)
tree_statistics = TreeStatistics(Tree=tree_2)  # -> Paths, Length, Count
branch_index_2 = Data(branch_index)
false = Boolean(False)
list_item = ListItem(List=tree_statistics.Paths, Index=branch_index_2, Wrap=false)
tree_branch = TreeBranch(Tree=tree_2, Path=list_item, MaintainPaths=True)
branch = Data(tree_branch)
branch_2 = Data(branch)
